# Grasshopper definition ARCHICAD_API_INSTALLER.gh (Grasshopper 1.0.7)

# Turn on to install ARCHICAD API
boolean_toggle = BooleanToggle(False)
ghpython_script = GhPythonScript(Install=boolean_toggle)  # -> out; inputs Install: Boolean
# ---------- ghpython_script: Python ----------
from Grasshopper.Folders import UserObjectFolders, DefaultAssemblyFolder
import os
import sys
import System.Net
import zipfile
import shutil
from distutils.dir_util import copy_tree

def rhinoVersion():
    RHINO_VERSION = ''
    script_path = ''
    for s in sys.path:
        if 'scripts' in s:
            script_path = s

    if '7.0' in script_path:
        RHINO_VERSION ='7'
    if '6.0' in script_path:
        RHINO_VERSION ='6'
    return RHINO_VERSION


def find_installed_rhino_scripts():

    """Get the path to the current user's Rhino scripts folder if it exists."""
    RHINO_VERSIONS = ('6.0', '7.0')
    installed_scripts = []
    home_folder = os.getenv('HOME') or os.path.expanduser('~')
    if os.name == 'nt':  # we are on Windows
        for ver in RHINO_VERSIONS:
            scripts_folder = os.path.join(home_folder, 'AppData', 'Roaming', 'McNeel',
                                          'Rhinoceros', ver, 'scripts')
            if os.path.isdir(scripts_folder):
                installed_scripts.append(scripts_folder)
    else:  # we are on Mac
        for ver in RHINO_VERSIONS:
            scripts_folder = os.path.join(home_folder, 'Library', 'Application Support',
                                          'McNeel', 'Rhinoceros', ver, 'scripts')
            if os.path.isdir(scripts_folder):
                installed_scripts.append(scripts_folder)
    return installed_scripts



def preparedir(target_dir, remove_content=True):
    """Prepare a folder for files to be written into it.

    This function creates the folder if it does not exist and removes the files in
    the folder if the folder already exists.

    This function has been copied from ladybug.futil.
    """
    if os.path.isdir(target_dir):
        if remove_content:
            nukedir(target_dir, False)
        return True
    else:
        try:
            os.makedirs(target_dir)
            return True
        except Exception as e:
            print("Failed to create folder: %s\n%s" % (target_dir, e))
            return False


def nukedir(target_dir, rmdir=False):
    """Delete all the files inside target_dir.

    This function has been copied from ladybug.futil.
    """
    d = os.path.normpath(target_dir)
    if not os.path.isdir(d):
        return

    files = os.listdir(d)
    for f in files:
        if f == '.' or f == '..':
            continue
        path = os.path.join(d, f)
        if os.path.isdir(path):
            nukedir(path)
        else:
            try:
                os.remove(path)
            except Exception:
                print("Failed to remove %s" % path)

    if rmdir:
        try:
            os.rmdir(d)
        except Exception:
            try:
                dir_util.remove_tree(d)
            except Exception:
                print("Failed to remove %s" % d)


def download_file_by_name(url, target_folder, file_name, mkdir=False):
    """Download a file to a directory.

    This function has been copied from ladybug_rhino.download.

    Args:
        url: A string to a valid URL.
        target_folder: Target folder for download (e.g. c:/ladybug)
        file_name: File name (e.g. testPts.zip).
        mkdir: Set to True to create the directory if doesn't exist (Default: False)
    """
    # create the target directory.
    if not os.path.isdir(target_folder):
        if mkdir:
            preparedir(target_folder)
        else:
            created = preparedir(target_folder, False)
            if not created:
                raise ValueError("Failed to find %s." % target_folder)
    file_path = os.path.join(target_folder, file_name)

    # set the security protocol to the most recent version
    try:
        # TLS 1.2 is needed to download over https
        System.Net.ServicePointManager.SecurityProtocol = \
            System.Net.SecurityProtocolType.Tls12
    except AttributeError:
        # TLS 1.2 is not provided by MacOS .NET
        if url.lower().startswith('https'):
            print ('This system lacks the necessary security'
                   ' libraries to download over https.')

    # attempt to download the file
    client = System.Net.WebClient()
    try:
        client.DownloadFile(url, file_path)
    except Exception as e:
        raise Exception(' Download failed with the error:\n{}'.format(e))



def unzip(src_zip,dest_folder):
    archive = zipfile.ZipFile(src_zip)
    for i in archive.namelist():
        if '__' not in i and '.DS' not in i:
            archive.extract(i,temp_directory)

import os
# Install = True
if Install:
    #folders
    rhinoVer = rhinoVersion()
    dest_script_folder = ''
    _script_folders     = find_installed_rhino_scripts()
    for path in _script_folders:
        if rhinoVer in path:
            dest_script_folder     =  path
    print  rhinoVer
    # print  dest_script_folder
    
    dest_script_folder     = find_installed_rhino_scripts()[0]
    dest_user_obj_folder = UserObjectFolders[0]
    # dest_user_obj_folder  = dest_user_obj_folder.replace(' ','\ ')
    repo_url =  'https://github.com/grzegorzwilk/archicad_api_grasshopper/raw/main/api.zip'
    temp_directory = os.path.join(os.path.expanduser('~'),'archicad_api_temp')
    

    user_objects_source = 'ARCHICAD_API'
    # user_objects_source = os.path.join('archicad_api_grasshopper','ARCHICAD_API')
    

    script_source = 'api2.py'
    # script_source = os.path.join('archicad_api_grasshopper','api2.py')
    

    zipfile_name = 'api.zip'
    zipfile_path = os.path.join(temp_directory,zipfile_name)



#     #downloading zip
    download_file_by_name(repo_url,temp_directory,zipfile_name,mkdir=True)
    unzip(zipfile_path,temp_directory)
#     #copy user objects to dest folder
    try:
        _destination_folder = os.path.join(dest_user_obj_folder,'ARCHICAD_API')
        isDir = os.path.isdir(_destination_folder)
        if isDir:
            try:
                shutil.rmtree(_destination_folder)
            except OSError as e:
                print '''Failed to remove existing ARCHICAD_API folder: 
                {0}
                Error:{1}
                Please remove it manually and try again'''.format(_destination_folder,e)
                
                
        else:
            print 'Folder ARCHICAD_API installed in UserObjectsFolder'
        print '''Folder ARCHICAD_API installed in UserObjectsFolder
        {}'''.format(_destination_folder)
        shutil.copytree(
            os.path.join(temp_directory,user_objects_source),
            _destination_folder
            )
    except Exception as e:
        print e
    # #copy script to scripts folder
    try:
        shutil.copyfile(
            os.path.join(temp_directory,script_source),
            os.path.join(dest_script_folder,'api2.py')
            )

    except Exception as e:
        print e


#     #removing temp directory
#     try:
#         shutil.rmtree(temp_directory)
#     except OSError as e:
#         print 'Failed to remove downloaded zip file: {}.'.format(zipfile_path)
# else:
#     print 'Turn On input node to install ARCHICAD PYTHON API Addon'
# ---------- end ghpython_script ----------
panel = Panel(ghpython_script)
